% Simulink data dictionary FlightControl.sldd

AccVec = Simulink.Bus()
  x: single, Unit="m/s^2"
  y: single, Unit="m/s^2"
  z: single, Unit="m/s^2"

GyroVec = Simulink.Bus()
  x: single, Unit="rad/s"
  y: single, Unit="rad/s"
  z: single, Unit="rad/s"

ControlSurfaceData = Simulink.Bus()
  ail_right: single, Min=-1, Max=1
  ail_left: single, Min=-1, Max=1
  flap_left: single, Min=-1, Max=1
  flap_right: single, Min=-1, Max=1
  rudder_left: single, Min=-1, Max=1
  rudder_right: single, Min=-1, Max=1

ImuData = Simulink.Bus()
  acc: Bus: AccVec
  omega: Bus: GyroVec  % omega_ib in body frame